# Grasshopper definition Triangle Weaving Generator.gh (Grasshopper 1.0.7)

panel = Panel("""{4,5,60}
{72,5,60}
{38,5,0}""")
Y = UnitY(Factor=1)
pt = Point(panel)
python = GhPythonScript(pts=pt, count=Slider(25, range=0..25), r_seed=Slider(26, range=0..100), Ampli=Slider(10, range=0..10), dir=Y)  # -> out, lns, cutter1, cutter2, cutter3; inputs pts: list of Point3d, count: Int32, r_seed: Int32, dir: Vector3d
# ---------- python: Python ----------
import ghpythonlib.components as gh
import random
random.seed(r_seed)


# Create triangle edges from input points
def create_ln(pts):
    ln1 = gh.Line(pts[0],pts[1])
    ln2 = gh.Line(pts[0],pts[2])
    ln3 = gh.Line(pts[1],pts[2])
    return ln1,ln2,ln3

lns = create_ln(pts)

#Generate woven curves inside triangle

def weave_pts(lns,count,Ampli,dir):
    result = []
    for i in range(count):
    #Evaluate Crvs
        pt1 = gh.EvaluateCurve(lns[0],random.random())[0]
        pt2 = gh.EvaluateCurve(lns[1],random.random())[0]
        pt3 = gh.EvaluateCurve(lns[2],random.random())[0]
    #create Crvs
        line1 = gh.Line(pt1, pt2)
        line2 = gh.Line(pt1, pt3)
        line3 = gh.Line(pt2, pt3)
    #move mid point of (line2,line3)
        m1 = gh.Move(gh.CurveMiddle(line2),gh.Amplitude(dir, Ampli))[0] 
        m2 = gh.Move(gh.CurveMiddle(line3),gh.Amplitude(dir, -Ampli))[0] 
    #updated crvs
        line2 = gh.Interpolate((pt1,m1,pt3),3,False,1)[0] 
        line3 = gh.Interpolate((pt2,m2,pt3),3,False,1)[0]
        result.append((line1,line2,line3))
    return result

lines = weave_pts(lns,count,Ampli,dir)
#output
cutter1 = [x[0] for x in lines]
cutter2 = [x[1] for x in lines]
cutter3 = [x[2] for x in lines]
# ---------- end python ----------
preview = CustomPreview(Geometry=python.lns, Material=ColourSwatch(SwatchColor=RGB(0, 0, 0)))
preview_2 = CustomPreview(Geometry=python.cutter1, Material=ColourSwatch(SwatchColor=RGB(227, 100, 100)))
preview_3 = CustomPreview(Geometry=python.cutter2, Material=ColourSwatch(SwatchColor=RGB(201, 8, 204)))
preview_4 = CustomPreview(Geometry=python.cutter3, Material=ColourSwatch(SwatchColor=RGB(8, 83, 153)))
